# Grasshopper definition Tensegrity_SimpleExample.gh (Grasshopper 1.0.7)
# plug-ins: Kangaroo2 Components

number_slider = Slider(8, range=1..10)
number_slider_2 = Slider(0.05, range=0..0.2)
sthinckness = GetNumber(Slider(1, range=1..5), AtLeast=1, AtMost=1, Maximum=1.797693135e+308, Minimum=-1.797693135e+308)
radius = GetNumber(number_slider, AtLeast=1, AtMost=1, Maximum=1.797693135e+308, Minimum=-1.797693135e+308)
segments = GetNumber(Slider(5, range=3..8), AtLeast=1, AtMost=1, Maximum=1.797693135e+308, Minimum=-1.797693135e+308)
height = GetNumber(Slider(4, range=2..8), AtLeast=1, AtMost=1, Maximum=1.797693135e+308, Minimum=-1.797693135e+308)
compress = GetNumber(Slider(4.19, range=0..10), AtLeast=1, AtMost=1, Maximum=1.797693135e+308, Minimum=-1.797693135e+308)
expands = GetNumber(Slider(4.19, range=0..10), AtLeast=1, AtMost=1, Maximum=1.797693135e+308, Minimum=-1.797693135e+308)
division = Division(A=sthinckness, B=Slider(20, range=0..100))
polygon = Polygon(Plane=PlaneXY(0, 0, 0), Radius=radius, Segments=segments, FilletRadius=0)  # -> Polygon, Length
unit_z = UnitZ(Factor=height)
move = Move(Geometry=polygon.Polygon, Motion=unit_z)  # -> Geometry, Transform
explode = Explode(Curve=polygon.Polygon, Recursive=True)  # -> Segments, Vertices
explode_2 = Explode(Curve=move.Geometry, Recursive=True)  # -> Segments, Vertices
removeduplicatepts = RemoveDuplicatePts(Points=explode.Vertices, Tolerance=0.01)
removeduplicatepts_2 = RemoveDuplicatePts(Points=explode_2.Vertices, Tolerance=0.01)
shift_list = ShiftList(List=removeduplicatepts_2, Shift=1, Wrap=True)
line = Line(StartPoint=removeduplicatepts, EndPoint=removeduplicatepts_2)
line_2 = Line(StartPoint=removeduplicatepts, EndPoint=shift_list)
number_slider_3 = Slider(0.807, range=0..1)
curve_base = Curve([explode.Segments, explode_2.Segments])
curve_base_2 = Curve([explode.Segments, explode_2.Segments])
point = Point([removeduplicatepts, removeduplicatepts_2])
division_2 = Division(A=compress, B=Slider(10, range=0..100))
length = Length(Curve=curve_base)
length_2 = Length(Curve=line_2)
division_3 = Division(A=expands, B=Slider(10, range=0..100))
merge = Merge(Data1=flatten(line), Data2=flatten(line_2), Data3=flatten(curve_base_2), Data4=flatten(point))
multiplication = Multiplication(A=length, B=division_3)
multiplication_2 = Multiplication(A=length_2, B=division_2)
panel = Panel(division_3)
show = Show(G=merge)
length_line = LengthLine(Line=line, Strength=10)
length_line_2 = LengthLine(Line=line_2, Length=multiplication_2, Strength=10)
length_line_3 = LengthLine(Line=curve_base, Length=multiplication, Strength=10)
merge_2 = Merge(Data1=show, Data2=length_line, Data3=length_line_2, Data4=length_line_3)
zombiesolver = ZombieSolver(GoalObjects=flatten(merge_2), Threshold=1e-10, Tolerance=0.0001, MaxIterations=50000)  # -> I, V, O
panel_2 = Panel(zombiesolver.O)
split_list = SplitList(List=flatten(zombiesolver.O), Index=Slider(32, range=0..60))  # -> ListA, ListB
split_list_2 = SplitList(List=flatten(zombiesolver.O), Index=number_slider)  # -> ListA, ListB
curve = Curve(split_list.ListA)
curve_2 = Curve(split_list_2.ListA)
mp = MultiPipe(Curves=curve, NodeSize=Slider(0.01, range=0..0.1), EndOffset=1, StrutSize=1, Segment=0, KinkAngle=0.6, CubeFit=0)
mp_2 = MultiPipe(Curves=curve_2, NodeSize=division, EndOffset=1, StrutSize=1, Segment=0, KinkAngle=0.6, CubeFit=0)
meshsubd = MeshFromSubD(SubD=mp, Density=2)
meshsubd_2 = MeshFromSubD(SubD=mp_2, Density=2)
clean = CombineClean(Meshes=meshsubd)
clean_2 = CombineClean(Meshes=meshsubd_2)
pt = ConstructPoint(XCoordinate=0, YCoordinate=0, ZCoordinate=0)
pt_2 = ConstructPoint(XCoordinate=0, YCoordinate=0, ZCoordinate=0)
medges = MeshEdges(Mesh=clean)  # -> NakedEdges, InteriorEdges, NonManifoldEdges
medges_2 = MeshEdges(Mesh=clean_2)  # -> NakedEdges, InteriorEdges, NonManifoldEdges
join = JoinCurves(Curves=medges.InteriorEdges, Preserve=False)
join_2 = JoinCurves(Curves=medges_2.NakedEdges, Preserve=False)
join_3 = JoinCurves(Curves=medges_2.InteriorEdges, Preserve=False)
join_4 = JoinCurves(Curves=medges.NakedEdges, Preserve=False)
merge_3 = Merge(Data1=join_2, Data2=join_3)  # -> flatten(Result)
curvepoint = PointOnCurve(merge_3, parameter=0.5)
pull = PullPoint(Point=curvepoint, Geometry=pt_2, ClosestOnly=True)  # -> ClosestPoint, Distance
bnd = Bounds(Numbers=pull.Distance)
remap = RemapNumbers(Value=pull.Distance, Source=bnd, Target=Domain(0, 1))  # -> Mapped, Clipped
merge_4 = Merge(Data1=join_4, Data2=join)  # -> flatten(Result)
curvepoint_2 = PointOnCurve(merge_4, parameter=0.5)
pull_2 = PullPoint(Point=curvepoint_2, Geometry=pt, ClosestOnly=True)  # -> ClosestPoint, Distance
bnd_2 = Bounds(Numbers=pull_2.Distance)
remap_2 = RemapNumbers(Value=pull_2.Distance, Source=bnd_2, Target=Domain(0, 1))  # -> Mapped, Clipped
gradient = Gradient(
    LowerLimit=0,
    UpperLimit=1,
    Parameter=remap_2.Mapped,
    stops=[0: RGB(234, 38, 0), 0.25: RGB(234, 126, 0), 0.5: RGB(254, 244, 84), 0.75: RGB(173, 203, 249), 1: RGB(75, 107, 169)])
gradient_2 = Gradient(LowerLimit=0, UpperLimit=1, Parameter=remap.Mapped, stops=[0.15: RGB(255, 130, 160), 0.85: RGB(220, 0, 40)])
list_length = ListLength(List=gradient)
list_length_2 = ListLength(List=gradient_2)
c_script = CSharpScript(crv=merge_4, color=gradient)  # -> out, A; inputs crv: Curve, color: Color
# ---------- c_script: C# ----------
    var c = color.R + "," + color.G + "," + color.B;
    crv.SetUserString("color", c);
    A = crv;
# ---------- end c_script ----------
c_script_2 = CSharpScript(crv=merge_3, color=gradient_2)  # -> out, A; inputs crv: Curve, color: Color
# ---------- c_script_2: C# ----------
    var c = color.R + "," + color.G + "," + color.B;
    crv.SetUserString("color", c);    
    A = crv;
# ---------- end c_script_2 ----------
series = Series(Start=0, Step=1, Count=list_length)
series_2 = Series(Start=0, Step=1, Count=list_length_2)

# ---- group: RH_OUT:edges01
curve_3 = Curve(flatten(c_script.A))

# ---- group: RH_OUT:edges00
curve_4 = Curve(flatten(c_script_2.A))
