# Grasshopper definition rnd_node.gh (Grasshopper 1.0.7)
# plug-ins: Kangaroo2 Components, Kangaroo Components

radius = Slider(12, range=5..20)
count = Slider(12, range=2..20)
radius_2 = GetNumber(radius, AtLeast=1, AtMost=1, Maximum=1.797693135e+308, Minimum=-1.797693135e+308)
count_2 = GetNumber(count, AtLeast=1, AtMost=1, Maximum=1.797693135e+308, Minimum=-1.797693135e+308)
sph = Sphere(Base=PlaneXY(0, 0, 0), Radius=radius_2)
pt = ConstructPoint(XCoordinate=0, YCoordinate=0, ZCoordinate=0)
popgeo = PopulateGeometry(Geometry=sph, Count=count_2, Seed=1)
division = Division(A=radius_2, B=count_2)
ln = Line(StartPoint=pt, EndPoint=popgeo)
mp = MultiPipe(Curves=ln, NodeSize=division, EndOffset=1, StrutSize=1, Segment=0, KinkAngle=0.6, CubeFit=0)
meshsubd = MeshFromSubD(SubD=mp, Density=2)
clean = CombineClean(Meshes=meshsubd)
clean_2 = CombineClean(Meshes=meshsubd)
pt_2 = ConstructPoint(XCoordinate=0, YCoordinate=0, ZCoordinate=0)
medges = MeshEdges(Mesh=clean_2)  # -> NakedEdges, InteriorEdges, NonManifoldEdges
join = JoinCurves(Curves=medges.NakedEdges, Preserve=False)
join_2 = JoinCurves(Curves=medges.InteriorEdges, Preserve=False)
merge = Merge(Data1=join, Data2=join_2)  # -> flatten(Result)
curvepoint = PointOnCurve(merge, parameter=0.5)
pull = PullPoint(Point=curvepoint, Geometry=pt_2, ClosestOnly=True)  # -> ClosestPoint, Distance
bnd = Bounds(Numbers=pull.Distance)
remap = RemapNumbers(Value=pull.Distance, Source=bnd, Target=Domain(0, 1))  # -> Mapped, Clipped
gradient = Gradient(
    LowerLimit=0,
    UpperLimit=1,
    Parameter=remap.Mapped,
    stops=[0: RGB(0, 34, 255), 0.5: RGB(255, 0, 85), 1: RGB(255, 153, 0)])
list_length = ListLength(List=gradient)
series = Series(Start=0, Step=1, Count=list_length)
c_script = CSharpScript(crv=merge, color=gradient, cost=series)  # -> out, A; inputs crv: Curve, color: Color, cost: String
# ---------- c_script: C# ----------
    var c = color.R + "," + color.G + "," + color.B;
    crv.SetUserString("color", c);
    crv.SetUserString("cost", cost);
    A = crv;
# ---------- end c_script ----------

# ---- group: RH_OUT:edges
curve = Curve(flatten(c_script.A))
